# Grasshopper definition housing.gh (Grasshopper 0.9.76)

height = Slider(30, range=20..50)
length = Slider(100, range=75..125)
width = Slider(100, range=75..125)
division = Division(A=height, B=2)
division_2 = Division(A=length, B=2)
division_3 = Division(A=width, B=2)
construct_point = ConstructPoint(XCoordinate=expr("-x", division_2), YCoordinate=expr("-x", division_3), ZCoordinate=expr("-x", division))
construct_point_2 = ConstructPoint(XCoordinate=division_2, YCoordinate=division_3, ZCoordinate=division)
box_2pt = Box2Pt(PointA=construct_point_2, PointB=construct_point, Plane=PlaneXY(0, 0, 0))
